# Dynamo custom node GetLineStylesAttributes.dyf (Dynamo 1.0.0.1180)
# category: BimorphNodes.Revit.LineStyles.Query
# Gets all the Revit Line Styles in the document and reports their Line Style Name, Weight and Colour as strings and integers

# group: NODE DETAILS
# note: AUTHOR
# Copyright 2016 Thomas Mahon
# @Thomas__Mahon
# note: CONTACT
# www.bimorph.co.uk
# info@bimorph.co.uk
# @bimorphBIM
# note: PACKAGE NAME
# bimorphNodes
# note: GITHUB
# https://github.com/ThomasMahon/bimorphNodes/

# group: Functions for sorting and structuring the Line Style data for exporting to Excel
sortLineStyles = CodeBlock()
# ---------- sortLineStyles.designscript (16 lines) ----------
//Copyright 2016. All rights reserved. Bimorph Consultancy LTD, 5 St Johns Lane, London EC1M 4BH www.bimorph.co.uk
//Written by Thomas Mahon @Thomas__Mahon info@bimorph.co.uk Package: bimorphNodes
//GitHub: https://github.com/ThomasMahon/bimorphNodes/

def sortLineStyles(lineStyleData:var[]..[])
{
 return = [Imperative]
 {
  lineStyleDataSorted = {};
  for (i in GetKeys(lineStyleData) )
  {
   lineStyleDataSorted[i] = List.SortByKey(lineStyleData[i], lineStyleData[0])["sorted list"];
  }
  return = lineStyleDataSorted;
 }
};
# ----------------------------------------

# group: Get the line styles and sort
python_script = Python()
# ---------- python_script.python (33 lines) ----------
#Copyright 2016. All rights reserved. Bimorph Consultancy LTD, 5 St Johns Lane, London EC1M 4BH www.bimorph.co.uk
#Written by Thomas Mahon @Thomas__Mahon info@bimorph.co.uk package: bimorphNodes
#GitHub: https://github.com/ThomasMahon/bimorphNodes/

import clr

# Import DocumentManager and TransactionManager
clr.AddReference("RevitServices")
import RevitServices
from RevitServices.Persistence import DocumentManager

# Import RevitAPI
clr.AddReference("RevitAPI")
import Autodesk
from Autodesk.Revit.DB import *

doc = DocumentManager.Instance.CurrentDBDocument

lineStyle = doc.Settings.Categories.get_Item( BuiltInCategory.OST_Lines )
lineStyleSubTypes = lineStyle.SubCategories

listNames = []
listRGB = []
lineWeight = []
for i in lineStyleSubTypes:
	rgb = [i.LineColor.Red, i.LineColor.Green, i.LineColor.Blue]
	weight = i.GetLineWeight(GraphicsStyleType.Projection)
	
	listNames.append(i.Name)
	listRGB.append(rgb)
	lineWeight.append(weight)

OUT = listNames, lineWeight, listRGB
# ----------------------------------------
code_block = CodeBlock(lineStyleData=python_script) { sortLineStyles(lineStyleData); }
code_block_2 = CodeBlock(lineStyles=code_block) { lineStyleNames = lineStyles[0]; lineStyleWeights = lineStyles[1]; lineStyleColour = lineStyles[2]; }

lineStylesName = Output(code_block_2.lineStyleNames)
lineStylesWeight = Output(code_block_2.lineStyleWeights)
lineStylesColour = Output(code_block_2.lineStyleColour)
