# Dynamo custom node GetScheduleDataColumns.dyf (Dynamo 1.0.0.1180)
# category: BimorphNodes.Revit.Schedule.Query
# Get the specified column data from a given schedule as strings
# Column indexes start at 0

# group: NODE DETAILS
# note: AUTHOR
# Copyright 2016 Thomas Mahon
# @Thomas__Mahon
# note: CONTACT
# www.bimorph.co.uk
# info@bimorph.co.uk
# @bimorphBIM
# note: PACKAGE NAME
# bimorphNodes
# note: GITHUB
# https://github.com/ThomasMahon/bimorphNodes/

scheduleViewOrName = Input(scheduleViewOrName:var)  # Enter the Revit schedule view or the schedule name as a string
columnIndexes = Input(columnIndexes:int[]..[])  # Enter the index or indexes of the required columns. Indexes start from 0
python_script = Python(IN[0]=scheduleViewOrName, IN[1]=columnIndexes)
# ---------- python_script.python (56 lines) ----------
#Copyright 2016. All rights reserved. Bimorph Consultancy LTD, 5 St Johns Lane, London EC1M 4BH www.bimorph.co.uk
#Written by Thomas Mahon @Thomas__Mahon info@bimorph.co.uk Package: bimorphNodes
#GitHub: https://github.com/ThomasMahon/bimorphNodes/

import clr

# Import DocumentManager and TransactionManager
clr.AddReference("RevitServices")
import RevitServices
from RevitServices.Persistence import DocumentManager

# Import RevitAPI
clr.AddReference("RevitAPI")
import Autodesk
from Autodesk.Revit.DB import *

doc = DocumentManager.Instance.CurrentDBDocument

scheduleName = IN[0]
columnIndexes = IN[1]

if isinstance(columnIndexes, list):
	indexList = columnIndexes
else:
	indexList = [columnIndexes]

collector = FilteredElementCollector(doc)
collector.OfClass( ViewSchedule );
elementlist = collector.ToElements()

if isinstance(scheduleName, str):
	schedule = None
	for i in elementlist:
		scheduleViewName = BuiltInParameter.VIEW_NAME
		viewName = i.get_Parameter( scheduleViewName ).AsString()
		
		if viewName == scheduleName:
			schedule = i
			break		
else:
	schedule = UnwrapElement(scheduleName)

table = schedule.GetTableData()
section = table.GetSectionData(SectionType.Body)
nRows = section.NumberOfRows
nColumns = section.NumberOfColumns

columnList = []
for column in indexList: 
	if column < nColumns:
		columnData = []
		for r in range(nRows): 
			columnData.Add( TableView.GetCellText(schedule, SectionType.Body, r, column) )
		columnList.Add( columnData )

OUT = columnList
# ----------------------------------------
scheduleDataColumn = Output(python_script)
