# Dynamo custom node GetSheetsFromSchedule.dyf (Dynamo 1.0.0.1180)
# category: BimorphNodes.Revit.Sheets.Query
# Collects and returns all Revit sheets from a Sheet List Schedule
# Ensure the Sheet Number field is included in the Schedule

# group: NODE DETAILS
# note: AUTHOR
# Copyright 2016 Thomas Mahon
# @Thomas__Mahon
# note: CONTACT
# www.bimorph.co.uk
# info@bimorph.co.uk
# @bimorphBIM
# note: PACKAGE NAME
# bimorphNodes
# note: GITHUB
# https://github.com/ThomasMahon/bimorphNodes/

sheetListScheduleViewOrName = Input(sheetListScheduleViewOrName:var)  # Enter a Revit Sheet List view or the schedule name as a string
python_script = Python(IN[0]=sheetListScheduleViewOrName)
# ---------- python_script.python (66 lines) ----------
#Copyright 2016. All rights reserved. Bimorph Consultancy LTD, 5 St Johns Lane, London EC1M 4BH www.bimorph.co.uk
#Written by Thomas Mahon @Thomas__Mahon info@bimorph.co.uk Package: bimorphNodes
#GitHub: https://github.com/ThomasMahon/bimorphNodes/

import clr

# Import DocumentManager and TransactionManager
clr.AddReference("RevitServices")
import RevitServices
from RevitServices.Persistence import DocumentManager

# Import RevitAPI
clr.AddReference("RevitAPI")
import Autodesk
from Autodesk.Revit.DB import *

doc = DocumentManager.Instance.CurrentDBDocument

sheetListName = IN[0]

collector = FilteredElementCollector(doc)
collector.OfClass( ViewSchedule );
elementlist = collector.ToElements()

sheetSchedule = None
if isinstance(sheetListName, str):
	schedule = None
	for i in elementlist:
		sheetViewName = BuiltInParameter.VIEW_NAME
		viewName = i.get_Parameter( sheetViewName ).AsString()
		
		if viewName == sheetListName:
			sheetSchedule = i
			break
else:
	sheetSchedule = UnwrapElement(sheetListName)


table = sheetSchedule.GetTableData()
section = table.GetSectionData(SectionType.Body)
nRows = section.NumberOfRows
nColumns = section.NumberOfColumns

columnIndex = None
for c in range(nColumns): 
	heading = TableView.GetCellText(sheetSchedule, SectionType.Body, 0, c)
	if heading == "Sheet Number":
		columnIndex = c
		break

sheetNumberList = []
for row in range(nRows)[2:]: 
	sheetNumberList.Add( TableView.GetCellText(sheetSchedule, SectionType.Body, row, columnIndex) )

collector = FilteredElementCollector(doc)
collector.OfClass( ViewSheet );
elementlist = collector.ToElements()

sheetList = []
for s in elementlist: 
	for n in sheetNumberList:
		if s.SheetNumber == n: 
			sheetList.Add(s)
			break

OUT = sheetList
# ----------------------------------------
sheets = Output(python_script)
