# Dynamo custom node bimorph.CADLayerNames.dyf (Dynamo 1.0.0.1180)
# category: BimorphNodes.DWG | DGN.Query
# Get the full list of layer names from a CAD Link or Import

# group: NODE DETAILS
# note: AUTHOR + COPYRIGHT
# Copyright 2016 Bimorph Consultancy
# Thomas Mahon
# @Thomas__Mahon
# note: CONTACT
# www.bimorph.co.uk
# info@bimorph.co.uk
# @bimorphBIM
# note: PACKAGE NAME
# bimorphNodes
# note: GITHUB
# To report bugs or suggest improvements or new features, visit:
# https://github.com/ThomasMahon/bimorphNodes/
# note: FOLLOW US
# Follow us to get the latest news on bimorph digital engineering and updates to bimorphNodes:
# FACEBOOK:  facebook.com/bimorphBIM
# LINKEDIN:  linkedin.com/company/bimorph-bim
# TWITTER:  @bimorphBIM

importInstance = Input()  # Input the ImportInstance to extract the layers
python_script = Python(IN[0]=importInstance)
# ---------- python_script.python (23 lines) ----------
#Copyright 2016. All rights reserved. Bimorph Consultancy LTD, 5 St Johns Lane, London EC1M 4BH www.bimorph.co.uk
#Written by Thomas Mahon @Thomas__Mahon info@bimorph.co.uk Package: bimorphNodes
#GitHub: https://github.com/ThomasMahon/bimorphNodes/
#Follow: facebook.com/bimorphBIM | linkedin.com/company/bimorph-bim | @bimorphBIM

import clr

# Import RevitAPI
clr.AddReference("RevitAPI")
import Autodesk
from Autodesk.Revit.DB import *

dwgImport = UnwrapElement(IN[0])

catSub = dwgImport.Category.SubCategories
enum = catSub.GetEnumerator()

nameList = []
while enum.MoveNext():
	layerName = enum.Current.Name
	nameList.Add( layerName )
	
OUT  = nameList
# ----------------------------------------
layerNames = Output(python_script)
