# Dynamo custom node bimorph.CreateNewLineStyles.dyf (Dynamo 1.0.0.1180)
# category: BimorphNodes.Revit.LineStyles.Create
# Create single or multiple new Line Styles in a Revit document from name, line weight and RGB values

# group: NODE DETAILS
# note: AUTHOR + COPYRIGHT
# Copyright 2016 Bimorph Consultancy
# Thomas Mahon
# @Thomas__Mahon
# note: CONTACT
# www.bimorph.co.uk
# info@bimorph.co.uk
# @bimorphBIM
# note: PACKAGE NAME
# bimorphNodes
# note: GITHUB
# To report bugs or suggest improvements or new features, visit:
# https://github.com/ThomasMahon/bimorphNodes/
# note: FOLLOW US
# Follow us to get the latest news on bimorph digital engineering and updates to bimorphNodes:
# FACEBOOK:  facebook.com/bimorphBIM
# LINKEDIN:  linkedin.com/company/bimorph-bim
# TWITTER:  @bimorphBIM

lineStylesName = Input(lineStylesName:string[])  # Provide a list of strings to name each new Line Style
lineStylesWeight = Input(lineStylesWeight:int[])  # Add the line wieghts for the new Line Styles as integers
lineStylesColour = Input(lineStylesColour:int[]..[])  # Add a list of RGB integer values for each Line Style. The values should be structured into sublists
run = Input(run:bool)  # Set to True to create the new Line Styles
python_script = Python(IN[0]=lineStylesName, IN[1]=lineStylesWeight, IN[2]=lineStylesColour, IN[3]=run)
# ---------- python_script.python (111 lines) ----------
#Copyright 2016. All rights reserved. Bimorph Consultancy LTD, 5 St Johns Lane, London EC1M 4BH www.bimorph.co.uk
#Written by Thomas Mahon @Thomas__Mahon info@bimorph.co.uk Package: bimorphNodes
#GitHub: https://github.com/ThomasMahon/bimorphNodes/
#Follow: facebook.com/bimorphBIM | linkedin.com/company/bimorph-bim | @bimorphBIM

import clr
clr.AddReference("RevitAPIUI")
from Autodesk.Revit.UI import TextBox
from Autodesk.Revit.UI import TaskDialog
from Autodesk.Revit.UI import TaskDialogCommonButtons

# Import DocumentManager and TransactionManager
clr.AddReference("RevitServices")
import RevitServices
from RevitServices.Persistence import DocumentManager
from RevitServices.Transactions import TransactionManager
from System.Collections.Generic import *

# Import RevitAPI
clr.AddReference("RevitAPI")
import Autodesk
from Autodesk.Revit.DB import *

doc = DocumentManager.Instance.CurrentDBDocument

def convertToList(testList):
	if isinstance(testList, list):
		return testList
	else:
		return [testList]
				
def convertToListOfLists(testColourList):
	msgTitle = "Colour data structure error"
	msgMessage = "The Line Style colours are not in sublists. Each RGB colour set should be defined in a sublist, eg: { {red, green, blue} }"
	if isinstance(testColourList, list): 
		if isinstance(testColourList[0], list):
			
			for i in testColourList: 
				if isinstance(i, list) and len(i) == 3:
					continue
				else: 
					TaskDialog.Show(msgTitle, msgMessage, TaskDialogCommonButtons.Ok)
					testColourList = True
					return testColourList
					
			return testColourList 
				
		else:
			if len(testColourList) == 3: 
				return [testColourList]
			else: 
				TaskDialog.Show(msgTitle, msgMessage, TaskDialogCommonButtons.Ok)
				testColourList = True
				return testColourList
	else:
		TaskDialog.Show(msgTitle, msgMessage, TaskDialogCommonButtons.Ok)
		testColourList = True
		return testColourList
			
run = IN[3]

if run:
	lineStylesName =  convertToList( IN[0] )
	lineStylesWeight =  convertToList( IN[1] )
	lineStylesColour = convertToListOfLists( IN[2] )
	if lineStylesColour == True:
		OUT = "Colour data structure error - colours should be input as integer sublists defining the RGB values"
	else:
		listLacingCheck = False 
		if len(lineStylesName) == len(lineStylesWeight) == len(lineStylesColour):
			listLacingCheck = True
		else:
			TaskDialog.Show("Lacing error", "The number of items in the name, line weight and line colours input lists do not match. Ensure there are an equal number of items in each list and try again", TaskDialogCommonButtons.Ok)
			OUT = "Lacing mismatch - ensure an equal number of items are in each input"
		
		if listLacingCheck:
			TransactionManager.Instance.EnsureInTransaction(doc)
			doc.Regenerate()
			
			categories = doc.Settings.Categories
			lineCategory =  doc.Settings.Categories.get_Item( BuiltInCategory.OST_Lines )
			lineSubCategory = lineCategory.SubCategories
			
			newLineStyleList = zip(lineStylesName, lineStylesWeight, lineStylesColour)
			
			errorReport = []
			for lineStyleData in newLineStyleList:
				try:
					inProject = False
					name = lineStyleData[0]
					for i in lineSubCategory:
						if i.Name == name:
							inProject = True
							errorReport.Add( "LineStyle " + name + " exists in the current document and cannot be created")
							break
					if inProject:
						continue
					else:
						newLineStyle = categories.NewSubcategory(lineCategory, name);
						newLineStyle.LineColor = Color(lineStyleData[2][0], lineStyleData[2][1], lineStyleData[2][2]);
						newLineStyle.SetLineWeight(lineStyleData[1], GraphicsStyleType.Projection);
					
				except:
					errorReport.Add( "LineStyle creation failed Check your data types are correctly wired to the node and retry" )
			
			TransactionManager.Instance.TransactionTaskDone()
			
			if errorReport == []:
				OUT = "All LineStyles successfully created"
			else:
				OUT = errorReport
# ----------------------------------------
report = Output(python_script)
