# Dynamo custom node bimorph.CurvesFromCADLayers.dyf (Dynamo 1.0.0.1180)
# category: BimorphNodes.DWG | DGN.Create
# Extract curves from a CAD link or import by layer name. Curves are organised into layer sublists. To create Revit Model Lines set the createModelLines input to true
# This node is also optimised to convert curve types that typically fail when using Revit.Elements.Element.Curves or Full Explode

# group: NODE DETAILS
# note: AUTHOR + COPYRIGHT
# Copyright 2016 Bimorph Consultancy
# Thomas Mahon
# @Thomas__Mahon
# note: CONTACT
# www.bimorph.co.uk
# info@bimorph.co.uk
# @bimorphBIM
# note: PACKAGE NAME
# bimorphNodes
# note: GITHUB
# To report bugs or suggest improvements or new features, visit:
# https://github.com/ThomasMahon/bimorphNodes/
# note: FOLLOW US
# Follow us to get the latest news on bimorph digital engineering and updates to bimorphNodes:
# FACEBOOK:  facebook.com/bimorphBIM
# LINKEDIN:  linkedin.com/company/bimorph-bim
# TWITTER:  @bimorphBIM

importInstance = Input()  # Input the ImportInstance to convert to curves
layerNames = Input(layerNames:string[]={})  # Enter the layer names for conversion. Leave blank to convert all layers
createModelLines = Input(createModelLines:bool=false)  # Set to True to convert into Revit Model Lines
python_script = Python(IN[0]=importInstance, IN[1]=layerNames, IN[2]=createModelLines)
# ---------- python_script.python (136 lines) ----------
#Copyright 2016. All rights reserved. Bimorph Consultancy LTD, 5 St Johns Lane, London EC1M 4BH www.bimorph.co.uk
#Written by Thomas Mahon @Thomas__Mahon info@bimorph.co.uk Package: bimorphNodes
#GitHub: https://github.com/ThomasMahon/bimorphNodes/
#Follow: facebook.com/bimorphBIM | linkedin.com/company/bimorph-bim | @bimorphBIM

import clr

# Import DocumentManager and TransactionManager
clr.AddReference("RevitServices")
import RevitServices
from RevitServices.Persistence import DocumentManager
from RevitServices.Transactions import TransactionManager
from System.Collections.Generic import *

clr.AddReference("RevitNodes")
import Revit
# Import ToProtoType, ToRevitType geometry conversion extension methods
clr.ImportExtensions(Revit.GeometryConversion)

# Import RevitAPI
clr.AddReference("RevitAPI")
import Autodesk
from Autodesk.Revit.DB import *

doc = DocumentManager.Instance.CurrentDBDocument
uiapp = DocumentManager.Instance.CurrentUIApplication
app = uiapp.Application

importDWG = UnwrapElement(IN[0])
nameOfLayersToImport = IN[1]
revitModelLines = IN[2]

if nameOfLayersToImport == None or nameOfLayersToImport == []: 
	catSub = importDWG.Category.SubCategories
	enum = catSub.GetEnumerator()
	
	nameOfLayersToImport = []
	while enum.MoveNext():
		layerName = enum.Current.Name
		nameOfLayersToImport.Add( layerName )

if isinstance(nameOfLayersToImport, list):
	layerList = nameOfLayersToImport
else:
	layerList = [nameOfLayersToImport]

def storageDictionary(crvListDict, eleGraphicStyleName, e):
	if eleGraphicStyleName in crvListDict.keys(): 
		crvListDict[eleGraphicStyleName].append( e )
	else:
		crvListDict[eleGraphicStyleName] = []
		crvListDict[eleGraphicStyleName].append( e )
		
	
def curveConversion (crv, revitModelLines, crvObject, refPlane):
	if revitModelLines == True:
		crv.Add( doc.Create.NewModelCurve( crvObject, refPlane) )
	else:
		crv.Add( crvObject.ToProtoType() )
	
TransactionManager.Instance.EnsureInTransaction(doc)

geomEnum = importDWG.Geometry[ Options() ].GetEnumerator()

crvListDict = dict()
failedFilter = []
while geomEnum.MoveNext(): 
	instGeom = geomEnum.Current.GetInstanceGeometry()
	
	instGeomEnum = instGeom.GetEnumerator()
	while instGeomEnum.MoveNext():
		e = instGeomEnum.Current
		try:
			graphicStyleId = e.GraphicsStyleId
					
			eleGraphicStyle = doc.GetElement(graphicStyleId)
			eleGraphicStyleName = eleGraphicStyle.GraphicsStyleCategory.Name
			
			
			if eleGraphicStyleName in layerList: 
				storageDictionary(crvListDict, eleGraphicStyleName, e)

		except:
			try: 
				vol = e.Volume
				
				if vol == 0.0: 
					edgesList = e.Edges
					edgesEnum = edgesList.GetEnumerator()

					while edgesEnum.MoveNext():
						edge = edgesEnum.Current
						eleGraphicStyle = doc.GetElement(edge.GraphicsStyleId)
						eleGraphicStyleName = eleGraphicStyle.GraphicsStyleCategory.Name
						
						if eleGraphicStyleName in layerList:
							storageDictionary(crvListDict, eleGraphicStyleName, edge.AsCurve() )
							
			except: 
				failedFilter.Add(e)

if "2015" in app.VersionName:
	levelParam = "Base Level"
else:
	levelParam = BuiltInParameter.IMPORT_BASE_LEVEL
	
levelId = importDWG.Parameter[levelParam].AsElementId()
pln = SketchPlane.Create(doc, levelId )
	
crvList = [ crv for crv in crvListDict.values() ] 

failedConversion = []
modelLines =  []
for subList in crvList: 
	crv = []
	for i in subList: 
		try:
			crvType = i.GetType()
			if crvType != Autodesk.Revit.DB.PolyLine:
				curveConversion(crv, revitModelLines, i, pln)
			else: 
				pt = i.GetCoordinates()
				count = i.NumberOfCoordinates
					
				for j in range(count-1): 
					ln = Line.CreateBound(pt[j], pt[j+1])
					curveConversion(crv, revitModelLines, ln, pln)
						
		except: 
			failedConversion.Add( i )
				
	modelLines.Add(crv)
	
TransactionManager.Instance.TransactionTaskDone()

OUT = modelLines, crvListDict.keys()
# ----------------------------------------
firstItem = List.FirstItem(python_script)
curves = Output(firstItem)
lastItem = List.LastItem(python_script)
layerKeys = Output(lastItem)
