# Dynamo custom node bimorph.DuplicateSheets.dyf (Dynamo 1.0.0.1180)
# category: BimorphNodes.Revit.Sheets.Create
# Duplicate selected sheets and any placed views with options to control if views are duplicated and the method of duplication
# ViewSchedules and Legends are currently not supported

# group: NODE DETAILS
# note: AUTHOR + COPYRIGHT
# Copyright 2016 Bimorph Consultancy
# Thomas Mahon
# @Thomas__Mahon
# note: CONTACT
# www.bimorph.co.uk
# info@bimorph.co.uk
# @bimorphBIM
# note: PACKAGE NAME
# bimorphNodes
# note: GITHUB
# To report bugs or suggest improvements or new features, visit:
# https://github.com/ThomasMahon/bimorphNodes/
# note: FOLLOW US
# Follow us to get the latest news on bimorph digital engineering and updates to bimorphNodes:
# FACEBOOK:  facebook.com/bimorphBIM
# LINKEDIN:  linkedin.com/company/bimorph-bim
# TWITTER:  @bimorphBIM

sheets = Input(sheets:Sheet[])  # Enter the Revit sheets to duplicate
run = Input(run:bool)  # Set to True to dupicate the input sheets
duplicateViews = Input(duplicateViews:bool)  # Set to True to duplicate views on the sheets
duplicateOption = Input(duplicateOption:int=0)  # Enter DuplicateOption: 0 = Duplicate. 1 = WithDetailing. 2 = AsDependent
suffix = Input(suffix:string)  # Add the suffix to add to duplicated sheet number and view names
affix = Input(affix:string="")  # Enter an optional affix at the start of the duplicated sheet number and view names
python_script = Python(IN[0]=sheets, IN[1]=run, IN[2]=duplicateViews, IN[3]=duplicateOption, IN[4]=suffix, IN[5]=affix)
# ---------- python_script.python (113 lines) ----------
#Copyright 2016. All rights reserved. Bimorph Consultancy LTD, 5 St Johns Lane, London EC1M 4BH www.bimorph.co.uk
#Written by Thomas Mahon @Thomas__Mahon info@bimorph.co.uk Package: bimorphNodes
#GitHub: https://github.com/ThomasMahon/bimorphNodes/
#Follow: facebook.com/bimorphBIM | linkedin.com/company/bimorph-bim | @bimorphBIM

import System
import itertools

import clr

# Import ToDSType(bool) extension method
clr.AddReference("RevitNodes")
import Revit
clr.ImportExtensions(Revit.Elements)

# Import DocumentManager and TransactionManager
clr.AddReference("RevitServices")
import RevitServices
from RevitServices.Persistence import DocumentManager
from RevitServices.Transactions import TransactionManager
from System.Collections.Generic import *

# Import RevitAPI
clr.AddReference("RevitAPI")
import Autodesk
from Autodesk.Revit.DB import *
from Autodesk.Revit.Exceptions import *

doc = DocumentManager.Instance.CurrentDBDocument
uiapp = DocumentManager.Instance.CurrentUIApplication
app = uiapp.Application

sheets = IN[0]
run = IN[1]
duplicateWithViews = IN[2]
duplicateOption = (ViewDuplicateOption.Duplicate, ViewDuplicateOption.WithDetailing, ViewDuplicateOption.AsDependent)[ IN[3] ]
affix = IN[4]
prefix = IN[5]

if run:
	if isinstance(sheets, list):
		sheetsList = sheets
	else:
		sheetsList = [sheets]
		
	TransactionManager.Instance.EnsureInTransaction(doc)
	
	allSheets = FilteredElementCollector(doc).OfCategory(BuiltInCategory.OST_Sheets)
	allSheetNumbers = []
	for i in allSheets:
		allSheetNumbers.Add( i.SheetNumber )
	
	allViews = FilteredElementCollector(doc).OfCategory(BuiltInCategory.OST_Views)
	allViewNames = []
	for i in allViews:
		allViewNames.Add( i.ViewName )
	
	report = []
	newSheetList = []
	sheetViews = []
	for i in sheetsList:
		doc.Regenerate() 
		unwrapSheet = UnwrapElement(i)
		sheetSuccessfullyDuplicated = False
		
		titleBlock = FilteredElementCollector(doc, ElementId(i.Id)).OfCategory(BuiltInCategory.OST_TitleBlocks).ToElements()
		titleBlockSymbol = titleBlock[0].Symbol
		
		currentSheetNumber = i.SheetNumber
		currentSheetName = unwrapSheet.get_Parameter( BuiltInParameter.SHEET_NAME ).AsString()
			
		newSheetNumberString = prefix + currentSheetNumber + affix
		if newSheetNumberString in allSheetNumbers:
			report.Add("Sheet " + newSheetNumberString + " exists in the document and cannot be duplicated" )
		else:
			newSheet = ViewSheet.Create(doc, ElementId(titleBlockSymbol.ToDSType(True).Id) )
			sheetSuccessfullyDuplicated = True
			
			sheetNumberParam = newSheet.get_Parameter( BuiltInParameter.SHEET_NUMBER )
			sheetNumberParam.Set( newSheetNumberString )
			allSheetNumbers.Add( newSheetNumberString )
		
			sheetName = newSheet.get_Parameter( BuiltInParameter.SHEET_NAME )
			sheetName.Set(currentSheetName)
			
			newSheetList.Add( doc.GetElement(newSheet.Id) )
			
			doc.Regenerate()
			if duplicateWithViews and sheetSuccessfullyDuplicated:
				viewPorts = FilteredElementCollector(doc, ElementId(i.Id)).OfCategory(BuiltInCategory.OST_Viewports).ToElements()

				ptXYZ = [] 
				for j in viewPorts:
					currentViewport = j
					ptXYZ = currentViewport.GetBoxCenter()
					
					getView = doc.GetElement(currentViewport.ViewId)
					newViewName = prefix + getView.ViewName + affix
					if newViewName in allViewNames:
						report.Add("View " + newViewName + " exists in the document and cannot be duplicated" )
					else:
						newView = getView.Duplicate(duplicateOption)
						newViewNameParam = doc.GetElement(newView).get_Parameter( BuiltInParameter.VIEW_NAME )
						newViewNameParam.Set(newViewName)
						
						addView = Viewport.Create(doc, ElementId(newSheet.ToDSType(True).Id), newView, ptXYZ)
						allViewNames.Add( newViewName )

	TransactionManager.Instance.TransactionTaskDone()
	if report == []:
		OUT = "Duplication process successful"
	else:	
		OUT = report, newSheetList
# ----------------------------------------
firstItem = List.FirstItem(python_script)
report = Output(firstItem)
lastItem = List.LastItem(python_script)
Sheets = Output(lastItem)
