# Dynamo custom node SetCADObjectStyles.dyf (Dynamo 1.0.0.1180)
# category: BimorphNodes.CAD.Actions
# Set weight and colour of CAD link or import layers Object Styles. Enter the layers to set as strings. The layer names are case-sensitive. The line weight and colour lists are mapped to the layerNames list using longest lacing

# group: NODE DETAILS
# note: AUTHOR + COPYRIGHT
# Copyright 2017 Bimorph Consultancy
# Thomas Mahon
# @Thomas__Mahon
# note: CONTACT
# www.bimorph.co.uk
# info@bimorph.co.uk
# @bimorphBIM
# note: PACKAGE NAME
# bimorphNodes
# note: GITHUB
# To report bugs or suggest improvements or new features, visit:
# https://github.com/ThomasMahon/bimorphNodes/
# note: FOLLOW US
# Follow us to get the latest digital engineering news & be the first to hear about bimorphNodes updates:
# FACEBOOK:  facebook.com/bimorphBIM
# LINKEDIN:  linkedin.com/company/bimorph-bim
# TWITTER:  @bimorphBIM
# note: USER GUIDE + DOWNLOADS
# For bimorphNodes user guides and downloadable example graphs, visit:
# www.bimorph.co.uk/bimorph-nodes

importInstance = Input()  # Input the ImportInstance containing the target layers
layerNames = Input(layerNames:string[])  # Input the layer name(s) to update. Names are case-sensitive
lineStylesWeight = Input(lineStylesWeight:int[])  # Input the line weight(s) setting for each layer(s)
lineStylesColour = Input(lineStylesColour:int[]..[])  # Input a list of RGB integer values for each Layer. The values should be structured into {R, G, B} sublists
python_script = Python(IN[0]=importInstance, IN[1]=layerNames, IN[2]=lineStylesWeight, IN[3]=lineStylesColour)
# ---------- python_script.python (96 lines) ----------
#Copyright 2017. All rights reserved. Bimorph Consultancy LTD, 5 St Johns Lane, London EC1M 4BH www.bimorph.co.uk
#Written by Thomas Mahon @Thomas__Mahon info@bimorph.co.uk Package: bimorphNodes
#GitHub: https://github.com/ThomasMahon/bimorphNodes/
#Follow: facebook.com/bimorphBIM | linkedin.com/company/bimorph-bim | @bimorphBIM

import clr

# Import RevitAPI
clr.AddReference("RevitAPI")
import Autodesk
from Autodesk.Revit.DB import *

clr.AddReference("RevitAPIUI")
import Autodesk
from Autodesk.Revit.UI import *

# Import DocumentManager and TransactionManager
clr.AddReference("RevitServices")
import RevitServices
from RevitServices.Persistence import DocumentManager
from RevitServices.Transactions import TransactionManager
from System.Collections.Generic import *

doc = DocumentManager.Instance.CurrentDBDocument

def convertToList(testList):
	if isinstance(testList, list):
		return testList
	else:
		return [testList]

def convertToLongestLists(testList, layerNameList):
	layerCount = len(layerNameList)
	testListCount = len(testList)
	if testListCount < layerCount:
		extraItems = layerCount -testListCount
		testList.extend([testList[-1]] * extraItems)
	return testList

def convertToListOfLists(testColourList):
	msgTitle = "bimorph.SetCADObjectStyles"
	msgMessage = "bimorph.SetCADObjectStyles:\nColour data structure error - The LineStyle colours are not in sublists. Each RGB colour set should be defined in a sublist, eg: { {red, green, blue} }"
	if isinstance(testColourList, list): 
		if isinstance(testColourList[0], list):
			
			for i in testColourList: 
				if isinstance(i, list) and len(i) == 3:
					continue
				else: 
					TaskDialog.Show(msgTitle, msgMessage, TaskDialogCommonButtons.Ok)
					testColourList = True
					return testColourList	
			return testColourList 
				
		else:
			if len(testColourList) == 3: 
				return [testColourList]
			else: 
				TaskDialog.Show(msgTitle, msgMessage, TaskDialogCommonButtons.Ok)
				
				testColourList = True
				return testColourList
	else:
		TaskDialog.Show(msgTitle, msgMessage, TaskDialogCommonButtons.Ok)
		testColourList = True
		return testColourList


dwgImport = UnwrapElement(IN[0])
layerNameList = convertToList( IN[1] )
lineWeight = convertToList( IN[2] )
colourList = convertToListOfLists( IN[3] )

if colourList == True:
	OUT = "Colour data structure error - colours should be input as integer sublists defining the RGB values"
else:
	TransactionManager.Instance.EnsureInTransaction(doc)

	lineWeight = convertToLongestLists(lineWeight, layerNameList)
	colourList = convertToLongestLists(colourList, layerNameList)
	
	catSub = dwgImport.Category.SubCategories
	for layer, c, w in zip(layerNameList, colourList, lineWeight):
		catSub.Item[layer].LineColor = Color(c[0], c[1], c[2])
		catSub.Item[layer].SetLineWeight(w, GraphicsStyleType.Projection)
	
	TransactionManager.Instance.TransactionTaskDone()
	
	vId = List[ElementId]( )
	vId.Add(dwgImport.Id)
	
	v = Autodesk.Revit.UI.UIDocument(doc).ActiveView
	v.HideElements(vId)
	v.UnhideElements(vId)
	
	OUT = "All layers successfully updated"
# ----------------------------------------
report = Output(python_script)
