# Dynamo custom node bimorph.CADLayersInUse.dyf (Dynamo 1.0.0.1180)
# category: BimorphNodes.CAD.Query
# Get the list of layer names from a CAD link or import that are in use and contain curves

# group: NODE DETAILS
# note: AUTHOR + COPYRIGHT
# Copyright 2017 Bimorph Consultancy
# Thomas Mahon
# @Thomas__Mahon
# note: CONTACT
# www.bimorph.co.uk
# info@bimorph.co.uk
# @bimorphBIM
# note: PACKAGE NAME
# bimorphNodes
# note: GITHUB
# To report bugs or suggest improvements or new features, visit:
# https://github.com/ThomasMahon/bimorphNodes/
# note: FOLLOW US
# Follow us to get the latest digital engineering news & be the first to hear about bimorphNodes updates:
# FACEBOOK:  facebook.com/bimorphBIM
# LINKEDIN:  linkedin.com/company/bimorph-bim
# TWITTER:  @bimorphBIM
# note: USER GUIDE + DOWNLOADS
# For bimorphNodes user guides and downloadable example graphs, visit:
# www.bimorph.co.uk/bimorph-nodes

importInstance = Input()  # Input the ImportInstance to find layers that are in use
python_script = Python(IN[0]=importInstance)
# ---------- python_script.python (58 lines) ----------
#Copyright 2017. All rights reserved. Bimorph Consultancy LTD, 5 St Johns Lane, London EC1M 4BH www.bimorph.co.uk
#Written by Thomas Mahon @Thomas__Mahon info@bimorph.co.uk Package: bimorphNodes
#GitHub: https://github.com/ThomasMahon/bimorphNodes/
#Follow: facebook.com/bimorphBIM | linkedin.com/company/bimorph-bim | @bimorphBIM

import clr

# Import DocumentManager and TransactionManager
clr.AddReference("RevitServices")
import RevitServices
from RevitServices.Persistence import DocumentManager

# Import RevitAPI
clr.AddReference("RevitAPI")
import Autodesk
from Autodesk.Revit.DB import *

doc = DocumentManager.Instance.CurrentDBDocument

importDWG = UnwrapElement(IN[0])

geomEnum = importDWG.Geometry[ Options() ].GetEnumerator()

failedFilter = []
layerList = []
while geomEnum.MoveNext(): 
	instGeom = geomEnum.Current.GetInstanceGeometry()
	
	instGeomEnum = instGeom.GetEnumerator()
	while instGeomEnum.MoveNext():
		e = instGeomEnum.Current
		try:
			graphicStyleId = e.GraphicsStyleId
					
			eleGraphicStyle = doc.GetElement(graphicStyleId)
			eleGraphicStyleName = eleGraphicStyle.GraphicsStyleCategory.Name
			
			layerList.Add(eleGraphicStyleName)
			
		except:
			try:
				vol = e.Volume
				
				if vol == 0.0:
					edgesList = e.Edges
					edgesEnum = edgesList.GetEnumerator()

					while edgesEnum.MoveNext():
						edge = edgesEnum.Current
						eleGraphicStyle = doc.GetElement(edge.GraphicsStyleId)
						eleGraphicStyleName = eleGraphicStyle.GraphicsStyleCategory.Name
						
						layerList.Add(eleGraphicStyleName)
						break	
			except:
				failedFilter.Add(e)
	
OUT = set(layerList)
# ----------------------------------------
layerNames = Output(python_script)
