# Dynamo custom node bimorph.GetLineStylesAttributes.dyf (Dynamo 1.0.0.1180)
# category: BimorphNodes.Revit.LineStyles.Query
# Gets all the Revit Line Styles in the document and reports their Line Style Name, Weight and Colour as strings and integers. The Revit GraphicsStyle (Category) element for each Line Style is also output.

# group: NODE DETAILS
# note: AUTHOR + COPYRIGHT
# Copyright 2017 Bimorph Consultancy
# Thomas Mahon
# @Thomas__Mahon
# note: CONTACT
# www.bimorph.co.uk
# info@bimorph.co.uk
# @bimorphBIM
# note: PACKAGE NAME
# bimorphNodes
# note: GITHUB
# To report bugs or suggest improvements or new features, visit:
# https://github.com/ThomasMahon/bimorphNodes/
# note: FOLLOW US
# Follow us to get the latest digital engineering news & be the first to hear about bimorphNodes updates:
# FACEBOOK:  facebook.com/bimorphBIM
# LINKEDIN:  linkedin.com/company/bimorph-bim
# TWITTER:  @bimorphBIM
# note: USER GUIDE + DOWNLOADS
# For bimorphNodes user guides and downloadable example graphs, visit:
# www.bimorph.co.uk/bimorph-nodes

python_script = Python()
# ---------- python_script.python (39 lines) ----------
#Copyright 2017. All rights reserved. Bimorph Consultancy LTD, 5 St Johns Lane, London EC1M 4BH www.bimorph.co.uk
#Written by Thomas Mahon @Thomas__Mahon info@bimorph.co.uk Package: bimorphNodes
#GitHub: https://github.com/ThomasMahon/bimorphNodes/
#Follow: facebook.com/bimorphBIM | linkedin.com/company/bimorph-bim | @bimorphBIM

import clr

# Import DocumentManager and TransactionManager
clr.AddReference("RevitServices")
import RevitServices
from RevitServices.Persistence import DocumentManager

# Import RevitAPI
clr.AddReference("RevitAPI")
import Autodesk
from Autodesk.Revit.DB import *

doc = DocumentManager.Instance.CurrentDBDocument

lineStyle = doc.Settings.Categories.get_Item( BuiltInCategory.OST_Lines )
lineStyleSubTypes = lineStyle.SubCategories

listNames = []
listRGB = []
lineWeight = []
graphicStyles = []
for i in lineStyleSubTypes:
	rgb = [i.LineColor.Red, i.LineColor.Green, i.LineColor.Blue]
	weight = i.GetLineWeight(GraphicsStyleType.Projection)
	
	listNames.append(i.Name)
	listRGB.append(rgb)
	lineWeight.append(weight)
	graphicStyles.Add( i.GetGraphicsStyle(GraphicsStyleType.Projection) )


syncSort = sorted( zip(listNames, lineWeight, listRGB, graphicStyles), key=lambda name: name[0] )

OUT = syncSort
# ----------------------------------------
transpose = List.Transpose(python_script)
code_block = CodeBlock(lineStyles=transpose)
# ---------- code_block.designscript (4 lines) ----------
lineStyleNames = lineStyles[0];
lineStyleWeights = lineStyles[1];
lineStyleColour = lineStyles[2];
revitLineStyles = lineStyles[3];
# ----------------------------------------
lineStylesName = Output(code_block.lineStyleNames)
lineStylesWeight = Output(code_block.lineStyleWeights)
lineStylesColour = Output(code_block.lineStyleColour)
refresh = Input(refresh:bool=true)  # To refresh, input a bool and switch its current state
GraphicStyle = Output(code_block.revitLineStyles)
