# Dynamo custom node bimorph.GetScheduleDataRows.dyf (Dynamo 1.0.0.1180)
# category: BimorphNodes.Revit.Schedule.Query
# Get the specified row data from a given schedule as strings
# Schedules have a blank row after the headings. Row indexes start at 0

# group: NODE DETAILS
# note: AUTHOR + COPYRIGHT
# Copyright 2017 Bimorph Consultancy
# Thomas Mahon
# @Thomas__Mahon
# note: CONTACT
# www.bimorph.co.uk
# info@bimorph.co.uk
# @bimorphBIM
# note: PACKAGE NAME
# bimorphNodes
# note: GITHUB
# To report bugs or suggest improvements or new features, visit:
# https://github.com/ThomasMahon/bimorphNodes/
# note: FOLLOW US
# Follow us to get the latest digital engineering news & be the first to hear about bimorphNodes updates:
# FACEBOOK:  facebook.com/bimorphBIM
# LINKEDIN:  linkedin.com/company/bimorph-bim
# TWITTER:  @bimorphBIM
# note: USER GUIDE + DOWNLOADS
# For bimorphNodes user guides and downloadable example graphs, visit:
# www.bimorph.co.uk/bimorph-nodes

scheduleView = Input(scheduleView:var)  # Enter the Revit schedule view or the schedule name as a string. String inputs are case-sensitive
rowIndex = Input(rowIndex:int[]..[])  # Enter the index or indexes of the required rows. Indexes start from 0
python_script = Python(IN[0]=scheduleView, IN[1]=rowIndex)
# ---------- python_script.python (57 lines) ----------
#Copyright 2017. All rights reserved. Bimorph Consultancy LTD, 5 St Johns Lane, London EC1M 4BH www.bimorph.co.uk
#Written by Thomas Mahon @Thomas__Mahon info@bimorph.co.uk Package: bimorphNodes
#GitHub: https://github.com/ThomasMahon/bimorphNodes/
#Follow: facebook.com/bimorphBIM | linkedin.com/company/bimorph-bim | @bimorphBIM

import clr

# Import DocumentManager and TransactionManager
clr.AddReference("RevitServices")
import RevitServices
from RevitServices.Persistence import DocumentManager

# Import RevitAPI
clr.AddReference("RevitAPI")
import Autodesk
from Autodesk.Revit.DB import *

doc = DocumentManager.Instance.CurrentDBDocument

scheduleName = IN[0]
rowIndexes = IN[1]

if isinstance(rowIndexes, list):
	indexList = rowIndexes
else:
	indexList = [rowIndexes]

collector = FilteredElementCollector(doc)
collector.OfClass( ViewSchedule );
elementlist = collector.ToElements()

if isinstance(scheduleName, str):
	schedule = None
	for i in elementlist:
		scheduleViewName = BuiltInParameter.VIEW_NAME
		viewName = i.get_Parameter( scheduleViewName ).AsString()
		
		if viewName == scheduleName:
			schedule = i
			break
else:
	schedule = UnwrapElement(scheduleName)

table = schedule.GetTableData()
section = table.GetSectionData(SectionType.Body)
nRows = section.NumberOfRows
nColumns = section.NumberOfColumns

rowList = []
for row in indexList: 
	if row < nRows: 
		rowData = []
		for c in range(nColumns): 
			rowData.Add( TableView.GetCellText(schedule, SectionType.Body, row, c) )
		rowList.Add( rowData )

OUT = rowList
# ----------------------------------------
scheduleDataRow = Output(python_script)
