# Dynamo custom node bimorph.RenumberRenameSheets.dyf (Dynamo 1.0.0.1180)
# category: BimorphNodes.Revit.Sheets.Actions
# Renumber and/or rename Revit sheets. To renumber or rename only, leave the other input empty. Sheets and newNumbers list's must be equal in length to run.
# The node uses an algorithm that handles common Revit sheet renumber warnings for more consistent results.

# group: NODE DETAILS
# note: AUTHOR + COPYRIGHT
# Copyright 2017 Bimorph Consultancy
# Thomas Mahon
# @Thomas__Mahon
# note: CONTACT
# www.bimorph.co.uk
# info@bimorph.co.uk
# @bimorphBIM
# note: PACKAGE NAME
# bimorphNodes
# note: GITHUB
# To report bugs or suggest improvements or new features, visit:
# https://github.com/ThomasMahon/bimorphNodes/
# note: FOLLOW US
# Follow us to get the latest digital engineering news & be the first to hear about bimorphNodes updates:
# FACEBOOK:  facebook.com/bimorphBIM
# LINKEDIN:  linkedin.com/company/bimorph-bim
# TWITTER:  @bimorphBIM
# note: USER GUIDE + DOWNLOADS
# For bimorphNodes user guides and downloadable example graphs, visit:
# www.bimorph.co.uk/bimorph-nodes

sheets = Input(sheets:Sheet[])  # Enter the Revit sheets to renumber or rename
newNumbers = Input(newNumbers:string[]={})  # Enter a list of sheet numbers to renumber the sheets. Leave empty to rename only
newNames = Input(newNames:string[]={})  # Enter a list of sheet names to rename the sheets. Leave empty to renumber only
run = Input(run:bool)  # Set to True to renumber and/or rename the input sheets
python_script = Python(IN[0]=sheets, IN[1]=newNumbers, IN[2]=newNames, IN[3]=run)
# ---------- python_script.python (104 lines) ----------
#Copyright 2017. All rights reserved. Bimorph Consultancy LTD, 5 St Johns Lane, London EC1M 4BH www.bimorph.co.uk
#Written by Thomas Mahon @Thomas__Mahon info@bimorph.co.uk Package: bimorphNodes
#GitHub: https://github.com/ThomasMahon/bimorphNodes/
#Follow: facebook.com/bimorphBIM | linkedin.com/company/bimorph-bim | @bimorphBIM

import clr
clr.AddReference("RevitAPIUI")
from Autodesk.Revit.UI import TextBox
from Autodesk.Revit.UI import TaskDialog
from Autodesk.Revit.UI import TaskDialogCommonButtons

# Import DocumentManager and TransactionManager
clr.AddReference("RevitServices")
import RevitServices
from RevitServices.Persistence import DocumentManager
from RevitServices.Transactions import TransactionManager
from System.Collections.Generic import *

# Import RevitAPI
clr.AddReference("RevitAPI")
import Autodesk
from Autodesk.Revit.DB import *

doc = DocumentManager.Instance.CurrentDBDocument

def convertToList(testList):
	if isinstance(testList, list):
		return testList
	else:
		return [testList]
		
def checkInputNamesForDuplicates(newNamesList):
	if len(newNamesList) != len( set(newNamesList) ):
		TaskDialog.Show("bimorph.RenumberOrRenameSheets", "bimorph.RenumberOrRenameSheets process terminated:\nThe list of newNumbers contains duplicates. Check your newNumbers list and ensure each name is unique", TaskDialogCommonButtons.Ok)
		return True
		
def sheetNumbers(sheetList):
	docSheetNumbers = []
	for s in sheetList:
		docSheetNumbers.Add( s.SheetNumber )
	return docSheetNumbers
		
def renameSheet(sheets, data, param):
	for s, n in zip(sheets, data):
		numberParam = s.get_Parameter( param )
		numberParam.Set(n)
	
run = IN[3]

collector = FilteredElementCollector(doc).OfClass( ViewSheet ).OfCategory( BuiltInCategory.OST_Sheets )
elementlist = collector.ToElements()

docSheetNumbers = sheetNumbers(elementlist)

lacingErrorMessage = "bimorph.RenumberOrRenameSheets:\nLacing Error - The sheets and newNumbers lists are not equal in length. Ensure both lists contain an equal number of items and try again"
dialogBoxName = "bimorph.RenumberOrRenameSheets"
outLacingError = "Rename terminated. Lacing mismatch - ensure an equal number of items are in the sheets and newNumbers lists"
renamedMessage = ""

if run:
	TransactionManager.Instance.EnsureInTransaction(doc)
	
	sheets = UnwrapElement( convertToList(IN[0]) )
	newNumbers = convertToList( IN[1] )
	newNames =  convertToList( IN[2] )
	
	renumberSheets = len(newNumbers) > 0
	renameSheets = len(newNames) > 0
	
	inputSheetNumbers = sheetNumbers(sheets)
	checkForDuplicates = checkInputNamesForDuplicates(newNumbers)
	if checkForDuplicates:
		OUT = "Renumber terminated - list of new sheet names contains duplicates. Provide unique names and try again"
	else:
		if renumberSheets:
			if len(sheets) == len(newNumbers):
				duplicateName = []
				for i in newNumbers:
					if i in docSheetNumbers and i not in inputSheetNumbers: 
						duplicateName.Add( i )
				if len(duplicateName) > 0: 
					TransactionManager.Instance.TransactionTaskDone()
					
					TaskDialog.Show(dialogBoxName, "bimorph.RenumberOrRenameSheets process terminated:\nThe following sheet numbers already exist and cannot be used to re-number the sheets. Provide a list of unique names and try again:\n" + str(duplicateName), TaskDialogCommonButtons.Ok)
					OUT = "Rename terminated - new sheet names conflict with existing sheets in the document: " + str(duplicateName) + ". Provide unique names and try again" 
				else:
					renameSheet(sheets, [s.Id for s in sheets], BuiltInParameter.SHEET_NUMBER) 
					renameSheet(sheets, newNumbers, BuiltInParameter.SHEET_NUMBER) 
					
					if renameSheets:
						renameSheet(sheets, newNames, BuiltInParameter.SHEET_NAME)
						renamedMessage = " and renamed"
					
					TransactionManager.Instance.TransactionTaskDone()
					OUT = "Sheets successfully renumbered" + renamedMessage
			else:
				TransactionManager.Instance.TransactionTaskDone()
				
				TaskDialog.Show(dialogBoxName, lacingErrorMessage, TaskDialogCommonButtons.Ok)
				OUT = outLacingError
		else:
			renameSheet(sheets, newNames, BuiltInParameter.SHEET_NAME)
			TransactionManager.Instance.TransactionTaskDone()
			OUT = "Sheets successfully renamed"
# ----------------------------------------
report = Output(python_script)
