# Dynamo custom node bimorph.ReportCADLinks.dyf (Dynamo 1.0.0.1180)
# category: BimorphNodes.CAD.Query
# Generates a report of all CAD links and imports in the document with key metrics. Linked and Imported CAD links are output into lists to aid with CAD link management.

# group: NODE DETAILS
# note: AUTHOR + COPYRIGHT
# Copyright 2017 Bimorph Consultancy
# Thomas Mahon
# @Thomas__Mahon
# note: CONTACT
# www.bimorph.co.uk
# info@bimorph.co.uk
# @bimorphBIM
# note: PACKAGE NAME
# bimorphNodes
# note: GITHUB
# To report bugs or suggest improvements or new features, visit:
# https://github.com/ThomasMahon/bimorphNodes/
# note: FOLLOW US
# Follow us to get the latest digital engineering news & be the first to hear about bimorphNodes updates:
# FACEBOOK:  facebook.com/bimorphBIM
# LINKEDIN:  linkedin.com/company/bimorph-bim
# TWITTER:  @bimorphBIM
# note: USER GUIDE + DOWNLOADS
# For bimorphNodes user guides and downloadable example graphs, visit:
# www.bimorph.co.uk/bimorph-nodes

filePath = Input(filePath:string="")  # To report the current document leave unconnected. To report an external Revit document or Family input a File Path and the file will be audited silently (without needing to open the file)
python_script = Python(IN[0]=filePath)
# ---------- python_script.python (91 lines) ----------
#Copyright 2017. All rights reserved. Bimorph Consultancy LTD, 5 St Johns Lane, London EC1M 4BH www.bimorph.co.uk
#Written by Thomas Mahon @Thomas__Mahon info@bimorph.co.uk Package: bimorphNodes
#GitHub: https://github.com/ThomasMahon/bimorphNodes/
#Follow: facebook.com/bimorphBIM | linkedin.com/company/bimorph-bim | @bimorphBIM

import clr

# Import RevitAPI
clr.AddReference("RevitAPI")
import Autodesk
from Autodesk.Revit.DB import *

# Import DocumentManager and TransactionManager
clr.AddReference("RevitServices")
import RevitServices
from RevitServices.Persistence import DocumentManager
#
def convertToList(listToConvert):
	if isinstance(listToConvert, list):
		return listToConvert
	else:
		return [listToConvert]

def cadAuditReporter(doc):
	cadLinkCollector = FilteredElementCollector(doc).OfClass(ImportInstance)
	cadLinks = cadLinkCollector.ToElements()
	
	CADLinkList = []
	CADImportList = []
	report = []
	for cad in cadLinks:
		name = cad.Parameter[BuiltInParameter.IMPORT_SYMBOL_NAME].AsString()
		isLinked = cad.IsLinked
		viewSpecific = cad.ViewSpecific 
		levelHost = doc.GetElement(cad.LevelId)
		
		ownerViewId = "Owner View : N/A"
		if viewSpecific:
			ownerViewId = doc.GetElement( cad.OwnerViewId )
			
		workSetId = cad.WorksetId
		worksetNames = None
		wSetsInDoc = FilteredWorksetCollector( doc )
		for w in wSetsInDoc:
			if w.Id == workSetId:
				worksetNames = "Workset : " + w.Name
		
		try:
			cadType = doc.GetElement( cad.GetTypeId() )
			cadExternalRef = cadType.GetExternalFileReference()
			path = ModelPathUtils.ConvertModelPathToUserVisiblePath( cadExternalRef.GetAbsolutePath() )
		
		except:
			path = "Path : N/A"
		
		if isLinked:
			cadType = doc.GetElement( cad.GetTypeId() )
			exRef = cadType.GetExternalFileReference()
			linkStatus = exRef.GetLinkedFileStatus()
		else:
			linkStatus = "Not a Link"
		
		CADLinkList.Add( cad ) if isLinked else CADImportList.Add( cad )		
		report.Add( [cad, name, "Is Linked : " + str(isLinked), "Status : " + str(linkStatus), "View Specific : " + str(viewSpecific), ownerViewId, worksetNames, path, levelHost] )
			
	return report, CADLinkList, CADImportList

uiapp = DocumentManager.Instance.CurrentUIApplication
app = uiapp.Application

processDocument = None
if IN[0] == "" or IN[0] == []:
	doc = DocumentManager.Instance.CurrentDBDocument
	processDocument = cadAuditReporter(doc)
	report = processDocument[0]
	CADLinkList = processDocument[1]
	CADImportList = processDocument[2]
	
else:
	report = []
	CADLinkList = []
	CADImportList = []
	filePath = convertToList(IN[0])
	for path in filePath:
		doc = app.OpenDocumentFile(FilePath( str(path) ), OpenOptions())
		processDocument = cadAuditReporter(doc) 
		report.Add(processDocument[0])
		CADLinkList.Add(processDocument[1])
		CADImportList.Add(processDocument[2])

OUT = "No Linked or Imported CAD files found" if report == [] else report, CADLinkList, CADImportList
# ----------------------------------------
code_block = CodeBlock(OUT=python_script) { OUT[0]; OUT[1]; OUT[2]; }
report = Output(code_block.out0)
CADLinks = Output(code_block.out1)
CADImports = Output(code_block.out2)
refresh = Input(refresh:bool=true)  # To refresh, switch a bool input to its opposing state
