# Dynamo custom node bimorph.SheetsFromSchedule.dyf (Dynamo 1.0.0.1180)
# category: BimorphNodes.Revit.Sheets.Query
# Collects and returns all Revit sheets from a Sheet List Schedule
# Ensure the Sheet Number field is included in the Schedule

# group: NODE DETAILS
# note: AUTHOR + COPYRIGHT
# Copyright 2017 Bimorph Consultancy
# Thomas Mahon
# @Thomas__Mahon
# note: CONTACT
# www.bimorph.co.uk
# info@bimorph.co.uk
# @bimorphBIM
# note: PACKAGE NAME
# bimorphNodes
# note: GITHUB
# To report bugs or suggest improvements or new features, visit:
# https://github.com/ThomasMahon/bimorphNodes/
# note: FOLLOW US
# Follow us to get the latest digital engineering news & be the first to hear about bimorphNodes updates:
# FACEBOOK:  facebook.com/bimorphBIM
# LINKEDIN:  linkedin.com/company/bimorph-bim
# TWITTER:  @bimorphBIM
# note: USER GUIDE + DOWNLOADS
# For bimorphNodes user guides and downloadable example graphs, visit:
# www.bimorph.co.uk/bimorph-nodes

sheetListScheduleView = Input(sheetListScheduleView:var)  # Enter a Revit Sheet List view or the Sheet List name as a string. String inputs are case-sensitive
python_script = Python(IN[0]=sheetListScheduleView)
# ---------- python_script.python (67 lines) ----------
#Copyright 2017. All rights reserved. Bimorph Consultancy LTD, 5 St Johns Lane, London EC1M 4BH www.bimorph.co.uk
#Written by Thomas Mahon @Thomas__Mahon info@bimorph.co.uk Package: bimorphNodes
#GitHub: https://github.com/ThomasMahon/bimorphNodes/
#Follow: facebook.com/bimorphBIM | linkedin.com/company/bimorph-bim | @bimorphBIM

import clr

# Import DocumentManager and TransactionManager
clr.AddReference("RevitServices")
import RevitServices
from RevitServices.Persistence import DocumentManager

# Import RevitAPI
clr.AddReference("RevitAPI")
import Autodesk
from Autodesk.Revit.DB import *

doc = DocumentManager.Instance.CurrentDBDocument

sheetListName = IN[0]

collector = FilteredElementCollector(doc)
collector.OfClass( ViewSchedule );
elementlist = collector.ToElements()

sheetSchedule = None
if isinstance(sheetListName, str):
	schedule = None
	for i in elementlist:
		sheetViewName = BuiltInParameter.VIEW_NAME
		viewName = i.get_Parameter( sheetViewName ).AsString()
		
		if viewName == sheetListName:
			sheetSchedule = i
			break
else:
	sheetSchedule = UnwrapElement(sheetListName)


table = sheetSchedule.GetTableData()
section = table.GetSectionData(SectionType.Body)
nRows = section.NumberOfRows
nColumns = section.NumberOfColumns

columnIndex = None
for c in range(nColumns): 
	heading = TableView.GetCellText(sheetSchedule, SectionType.Body, 0, c)
	if heading == "Sheet Number":
		columnIndex = c
		break

sheetNumberList = []
for row in range(nRows)[2:]: 
	sheetNumberList.Add( TableView.GetCellText(sheetSchedule, SectionType.Body, row, columnIndex) )

collector = FilteredElementCollector(doc)
collector.OfClass( ViewSheet );
elementlist = collector.ToElements()

sheetList = []
for s in elementlist: 
	for n in sheetNumberList:
		if s.SheetNumber == n: 
			sheetList.Add(s)
			break

OUT = sheetList
# ----------------------------------------
Sheets = Output(python_script)
